# Grasshopper definition Boxes-to-lines.gh (Grasshopper 1.0.7)
# plug-ins: Human, Pufferfish, Heteroptera, Kangaroo2 Components, Topologizer, Mesh Pipe, MetaHopper, Kangaroo Components, TT Toolbox, Parakeet

brep = Brep([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])

seed = Slider(32, range=0..100)

# ---- group: x
python = GhPythonScript(y=seed)  # -> out, c
# ---------- python: Python ----------
import random as random
dims=[50,60,70,80,90,100]
a=[0]
rem=300
random.seed(y)
while rem>49:
    r= random.randint(0, len(dims)-1)
    rem =rem-dims[r]
    if rem>0 :
        a.append(dims[r])


    print rem
c=[]
b=0
for i in a:
    if i==0:
        c.append(i)
    else:
        b= b+ i
        c.append(b)
# ---------- end python ----------
shift = ShiftList(List=python.c, Shift=1, Wrap=False)
short = ShortestList(ListA=python.c, ListB=shift, TrimMode=2)  # -> ListA, ListB
dom = ConstructDomain(DomainStart=short.ListA, DomainEnd=short.ListB)

# ---- group: y
python_2 = GhPythonScript(y=seed)  # -> out, c
# ---------- python_2: Python ----------
import random as random
dims=[50,60,70,80,90,100]
a=[0]
rem=300
random.seed(1+y)
while rem>49:
    r= random.randint(0, len(dims)-1)
    rem =rem-dims[r]
    if rem>0 :
        a.append(dims[r])


    print rem
c=[]
b=0
for i in a:
    if i==0:
        c.append(i)
    else:
        b= b+ i
        c.append(b)
# ---------- end python_2 ----------
shift_2 = ShiftList(List=python_2.c, Shift=1, Wrap=False)
short_2 = ShortestList(ListA=python_2.c, ListB=shift_2, TrimMode=2)  # -> ListA, ListB
dom_2 = ConstructDomain(DomainStart=short_2.ListA, DomainEnd=short_2.ListB)

# ---- group: z
python_3 = GhPythonScript(y=seed)  # -> out, move, ext
# ---------- python_3: Python ----------
import random as random
dims=[50,60,70,80,90,100]
a=[0]

rem=200
random.seed(2+y)
while rem>49:
    r= random.randint(0, len(dims)-1)
    rem =rem-dims[r]
    if rem>0 :
        a.append(dims[r])


    print rem
move=[]

b=0
for i in a:
    if i==0:
        move.append(i)
    else:
        b= b+ i
        move.append(b)

a.remove(0)
ext= a
# ---------- end python_3 ----------
cull_i = CullIndex(List=python_3.move, Indices=-1, Wrap=True)
Z = UnitZ(Factor=cull_i)  # -> graft(UnitVector)

# ----
debrep = DeconstructBrep(Brep=brep)  # -> flatten(Faces), Edges, Vertices
lng = ListLength(List=brep)
srf = Surface(flatten(debrep.Faces))
swatch = ColourSwatch(SwatchColor=RGB(0, 0, 0))
multiplication = Multiplication(A=lng, B=Slider(0.95, range=0..1))
reduce = RandomReduce(List=brep, Reduction=multiplication, Seed=1)
explode = Explode(Curve=srf, Recursive=True)  # -> flatten(Segments), flatten(Vertices)
eval = EvaluateCurve(Curve=reparameterize(explode.Segments), Parameter=0.5)  # -> Point, Tangent, Angle
area = Area(Geometry=srf)  # -> Area, Centroid
brep_2 = Brep([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])
swatch_2 = ColourSwatch(SwatchColor=RGB(0, 0, 0))
cullpt = CullDuplicates(Points=area.Centroid, Tolerance=0.1, CullMode=1)  # -> Points, Indices, Valence
cullpt_2 = CullDuplicates(Points=eval.Point, Tolerance=0.1, CullMode=1)  # -> Points, Indices, Valence
cullpt_3 = CullDuplicates(Points=explode.Vertices, Tolerance=0.1, CullMode=1)  # -> Points, Indices, Valence
item = ListItem(List=srf, Index=cullpt.Indices, Wrap=True)
item_2 = ListItem(List=explode.Segments, Index=cullpt_2.Indices, Wrap=True)

# ----
# ELEVATOR
previewmat = CustomPreviewMaterials(Geometry=brep_2, DiffuseColor=ColourSwatch(SwatchColor=RGB(255, 255, 255)), Transparency=Slider(0.69, range=0..1))
toggle = GroupToggle(ToggleActive=False, ToggleVisible=True)  # disabled

srf_2 = Surface(item)
crv = Curve(item_2)
pt = Point(cullpt_3.Points)
dom_3 = ConstructDomain(DomainStart=Slider(0, range=0..100), DomainEnd=Slider(300, range=0..1000))
sdivide = DivideSurface(Surface=srf_2, UCount=3, VCount=2)  # -> flatten(Points), Normals, Parameters; disabled
rectangle = Rectangle(Plane=PlaneXY(0, 0, 0), XSize=dom_3, YSize=dom_3, Radius=0)  # -> Rectangle, Length
dom² = ConstructDomain²(DomainU=dom, DomainV=graft(dom_2))
pt_2 = Point(pt)
srf_3 = Surface(rectangle.Rectangle)
cullpt_4 = CullDuplicates(Points=sdivide.Points, Tolerance=0.1, CullMode=3)  # -> Points, Indices, Valence; disabled
pt_3 = Point([Point(-791.9344086, -327.1087021, 2.25), Point(-791.9344086, -329.1087021, 2.25), Point(-789.9344086, -331.1087021, -1.381904115e-11), Point(-789.9344086, -331.1087021, 2.25), Point(-787.9344086, -331.1087021, -1.381904115e-11), Point(-787.9344086, -331.1087021, 2.25)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])
evalsrf = EvaluateSurface(Surface=reparameterize(srf_2), Point="0.5, 0.5")  # -> Point, Normal, UDirection, VDirection, Frame
subsrf = Isotrim(Surface=srf_3, Domain=graft(dom²))  # -> flatten(Surface)
dots = DotDisplay(Point=flatten(pt_3), Colour=ColourSwatch(SwatchColor=RGBA(148, 148, 148, 15)), Size=0.1)  # disabled
lng_2 = ListLength(List=pt_2)
lng_3 = ListLength(List=pt_2)
pl = PlaneNormal(Origin=evalsrf.Point, ZAxis=evalsrf.Normal)
dom_4 = ConstructDomain(DomainStart=Slider(0, range=0..1), DomainEnd=Slider(0.65, range=0..1))
lng_4 = ListLength(List=pt_2)
dom_5 = ConstructDomain(DomainStart=Slider(0.1, range=0..1), DomainEnd=Slider(0.3, range=0..1))
move = Move(Geometry=subsrf, Motion=graft(Z))  # -> simplify(Geometry), Transform
number_slider = Slider(0.25, range=0..1)
number_slider_2 = Slider(0.25, range=0..1)
Z_2 = UnitZ(Factor=python_3.ext)  # -> graft(UnitVector)
dup = DuplicateData(Data=Slider(6, range=0..10), Number=lng_3, Order=True)  # -> simplify(graft(Data))
offcrv = OffsetCurve(Curve=srf_2, Plane=pl, Distance=Slider(-0.3, range=-0.4..0.8), BothSides=invert(False), Kinks=0, CapType=1)
random = Random(Range=dom_4, Number=lng_2, Seed=2)
dom_6 = ConstructDomain(DomainStart=0, DomainEnd=Slider(1.2, range=0..5))
random_2 = Random(Range=dom_5, Number=lng_4, Seed=2)
extr = Extrude(Base=move.Geometry, Direction=graft(Z_2))  # -> flatten(Extrusion)
lng_5 = ListLength(List=extr)
multiplication_2 = Multiplication(A=lng_5, B=Slider(0.51, range=0.3..1))
area_2 = Area(Geometry=offcrv)  # -> Area, Centroid
int = Integer(multiplication_2)
rnd_vector = RandomVector(Number=dup, Length=dom_6, isflat=True)
msphere = MeshSphere(Base=pt_2, Radius=random, UCount=10, VCount=20)

# ---- group: voxel
reduce_2 = RandomReduce(List=extr, Reduction=int, Seed=Slider(30, range=0..100))

# ----
sort = SortList(Keys=area_2.Area, ValuesA=offcrv)  # -> simplify(Keys), ValuesA
msphere_2 = MeshSphere(Base=pt_2, Radius=random_2, UCount=10, VCount=20)
vlen = VectorLength(Vector=rnd_vector)
line = LineSDL(Start=simplify(graft(pt_2)), Direction=rnd_vector, Length=vlen)
item_3 = ListItem(List=sort.ValuesA, Index=0, Wrap=True)  # -> flatten(Item)
debrep_2 = DeconstructBrep(Brep=reduce_2)  # -> flatten(Faces), Edges, Vertices
swatch_3 = ColourSwatch(SwatchColor=RGB(230, 0, 19))
swatch_4 = ColourSwatch(SwatchColor=RGB(0, 0, 0))
swatch_5 = ColourSwatch(SwatchColor=RGB(255, 255, 0))
swatch_6 = ColourSwatch(SwatchColor=RGB(255, 255, 255))
swatch_7 = ColourSwatch(SwatchColor=RGB(207, 207, 207))
line_2 = Line(flatten(line))

boundary = BoundarySurfaces(Edges=item_3)  # -> flatten(Surfaces)
srf_4 = Surface(boundary)

area_3 = Area(Geometry=debrep_2.Faces)  # -> Area, Centroid
area_4 = Area(Geometry=srf_4)  # -> Area, Centroid

# ----
# NODES
preview = CustomPreview(Geometry=msphere, Material=ColourSwatch(SwatchColor=RGB(224, 224, 224)))
toggle_2 = GroupToggle(ToggleActive=True, ToggleVisible=False)  # disabled

previewlw = CustomPreviewLineweights(Geometry=line_2, Shader=swatch_7, Thickness=Slider(0.11, range=0..1), Absolute=invert(False))
preview_2 = CustomPreview(Geometry=msphere_2, Material=swatch_7)

pdecon = Deconstruct(Point=area_3.Centroid)  # -> XComponent, YComponent, ZComponent
pdecon_2 = Deconstruct(Point=area_4.Centroid)  # -> XComponent, YComponent, ZComponent
round = Round(Number=pdecon.ZComponent)  # -> Nearest, Floor, Ceiling
srf_5 = Surface(srf_4)
round_2 = Round(Number=pdecon_2.ZComponent)  # -> Nearest, Floor, Ceiling
pt_4 = Point(pt)
equals = Equality(FirstNumber=round.Nearest, SecondNumber=0)  # -> Equality, Inequality
equals_2 = Equality(FirstNumber=round_2.Nearest, SecondNumber=0)  # -> Equality, Inequality
cull = CullPattern(List=debrep_2.Faces, CullPattern=equals.Inequality)
cull_2 = CullPattern(List=srf_4, CullPattern=equals_2.Inequality)
area_5 = Area(Geometry=srf_5)  # -> Area, Centroid
jitter = Jitter(List=cull, Jitter=1, Seed=2)  # -> Values, Indices
swatch_8 = ColourSwatch(SwatchColor=RGB(0, 0, 0))
yz = YZPlane(Origin=pt_4)
panel = Panel("90")
area_6 = Area(Geometry=jitter.Values)  # -> Area, Centroid
jitter_2 = Jitter(List=cull_2, Jitter=1, Seed=2)  # -> Values, Indices
cullduppoints = RemoveDuplicatePoints(InputPoints=area_6.Centroid, Tolerance=0.001)  # -> OutputPoints, FirstPointIndexes
swatch_9 = ColourSwatch(SwatchColor=RGB(0, 0, 0))
clean = CleanTree(RemoveNulls=True, RemoveInvalid=True, RemoveEmpty=True, Tree=cullduppoints.FirstPointIndexes)
cull_i_2 = CullIndex(List=jitter.Values, Indices=clean, Wrap=True)
lng_6 = ListLength(List=cull_i_2)
lng_7 = ListLength(List=jitter_2.Values)
yz_2 = YZPlane(Origin=area_5.Centroid)
multiplication_3 = Multiplication(A=lng_6, B=Slider(0.2, range=0..1))
multiplication_4 = Multiplication(A=lng_7, B=Slider(0.1, range=0..1))
split = SplitList(List=jitter_2.Values, Index=multiplication_4)  # -> ListA, ListB
split_2 = SplitList(List=cull_i_2, Index=multiplication_3)  # -> ListA, ListB
split_3 = SplitList(List=split_2.ListB, Index=multiplication_3)  # -> ListA, ListB
split_4 = SplitList(List=split.ListB, Index=multiplication_4)  # -> ListA, ListB
split_5 = SplitList(List=split_3.ListB, Index=multiplication_3)  # -> ListA, ListB
split_6 = SplitList(List=split_4.ListB, Index=multiplication_4)  # -> ListA, ListB
geo = Geometry(split_4.ListA)
geo_2 = Geometry(split.ListA)
geo_3 = Geometry(split_6.ListA)
geo_4 = Geometry(split_6.ListB)
crv_2 = Curve(crv)
explode_2 = Explode(Curve=geo_2, Recursive=True)  # -> Segments, Vertices
explode_3 = Explode(Curve=geo, Recursive=True)  # -> Segments, Vertices
explode_4 = Explode(Curve=geo_3, Recursive=True)  # -> Segments, Vertices

# ---- group: dimeter1,2
geo_5 = Geometry(split_5.ListA)
explode_5 = Explode(Curve=geo_5, Recursive=True)  # -> Segments, Vertices
item_4 = ListItem(List=explode_5.Vertices, Index=0, Wrap=True)  # -> Item, Item1, Item2, Item3
ln = Line(StartPoint=item_4.Item, EndPoint=item_4.Item2)
ln_2 = Line(StartPoint=item_4.Item1, EndPoint=item_4.Item3)
dupln = RemoveDuplicateLines(Lines=flatten(ln), Tolerance=0.01)
cullduplines = RemoveDuplicateLines(InputLines=flatten(ln_2), Tolerance=0.001)  # -> OutputLines, FirstLineIndexes
clean_2 = CleanTree(RemoveNulls=True, RemoveInvalid=True, RemoveEmpty=True, Tree=cullduplines.OutputLines)
pt_5 = ConstructPoint(XCoordinate="0.5", YCoordinate="0.5", ZCoordinate=0)
evalsrf_2 = EvaluateSurface(Surface=reparameterize(geo_5), Point=pt_5)  # -> Point, Normal, UDirection, VDirection, Frame
amp = Amplitude(Vector=evalsrf_2.Normal, Amplitude="-2")
move_2 = Move(Geometry=flatten(clean_2), Motion=amp)  # -> Geometry, Transform
cluster = Cluster_2(C=move_2.Geometry)
cluster_2 = Cluster_2(C=dupln)

# ----
number_slider_3 = Slider(-4, range=-10..-4)
dupln_2 = RemoveDuplicateLines(Lines=flatten(debrep_2.Edges), Tolerance=0.01)
ext = ExtendCurve(Curve=dupln_2, Type=0, Start=number_slider_3, End=number_slider_3)

# ---- group: diameter1
geo_6 = Geometry(split_2.ListA)
explode_6 = Explode(Curve=geo_6, Recursive=True)  # -> Segments, Vertices
item_5 = ListItem(List=explode_6.Vertices, Index=0, Wrap=True)  # -> Item, Item1, Item2, Item3
ln_3 = Line(StartPoint=item_5.Item1, EndPoint=item_5.Item3)
dupln_3 = RemoveDuplicateLines(Lines=flatten(ln_3), Tolerance=0.01)
cluster_3 = Cluster_2(C=dupln_3)

# ---- group: diameter2
geo_7 = Geometry(split_3.ListA)
explode_7 = Explode(Curve=geo_7, Recursive=True)  # -> Segments, Vertices
item_6 = ListItem(List=explode_7.Vertices, Index=0, Wrap=True)  # -> Item, Item1, Item2, Item3
ln_4 = Line(StartPoint=item_6.Item, EndPoint=item_6.Item2)
dupln_4 = RemoveDuplicateLines(Lines=flatten(ln_4), Tolerance=0.01)
cluster_4 = Cluster_2(C=dupln_4)

# ---- group: actuator
line_3 = Line(flatten([dupln_3, dupln_4, move_2.Geometry]))
lng_8 = ListLength(List=line_3)
multiplication_5 = Multiplication(A=lng_8, B=Slider(0.51, range=0..1))
reduce_3 = RandomReduce(List=line_3, Reduction=multiplication_5, Seed=1)
len = Length(Curve=reduce_3)
subtraction = Subtraction(A=len, B="20")
number_slider_4 = Slider(3, range=0..10)
division = Division(A=subtraction, B=-2)
ext_2 = ExtendCurve(Curve=reduce_3, Type=0, Start=division, End=division)
previewlw_2 = CustomPreviewLineweights(Geometry=ext_2, Shader=ColourSwatch(SwatchColor=RGB(255, 255, 5)), Thickness=number_slider_4, Absolute=invert(False))

# ----
item_7 = ListItem(List=explode_2.Vertices, Index=0, Wrap=True)  # -> Item, Item1, Item2, Item3
item_8 = ListItem(List=explode_4.Vertices, Index=0, Wrap=True)  # -> Item, Item1, Item2, Item3
item_9 = ListItem(List=explode_3.Vertices, Index=0, Wrap=True)  # -> Item, Item1, Item2, Item3
number_slider_5 = Slider(0.13, range=0..1)
ln_5 = Line(StartPoint=item_7.Item1, EndPoint=item_7.Item3)
ln_6 = Line(StartPoint=item_9.Item, EndPoint=item_9.Item2)
number_slider_6 = Slider(0.09, range=0..1)
ln_7 = Line(StartPoint=item_8.Item1, EndPoint=item_8.Item3)
ln_8 = Line(StartPoint=item_8.Item, EndPoint=item_8.Item2)
swatch_10 = ColourSwatch(SwatchColor=RGB(82, 82, 82))
col = Colour(swatch_10)

cluster_5 = Cluster_2(C=crv_2)
cluster_6 = Cluster()  # -> R, R_2, R_3
cull_3 = CullPattern(List=cluster_5, CullPattern=cluster_6.R)
cull_4 = CullPattern(List=cluster_5, CullPattern=cluster_6.R_2)
cull_5 = CullPattern(List=cluster_5, CullPattern=cluster_6.R_3)
number_slider_7 = Slider(0.1, range=0..1)
number_slider_8 = Slider(0.02, range=0..1)
number_slider_9 = Slider(0.03, range=0..1)
shader = Shader(swatch_10)
swatch_11 = ColourSwatch(SwatchColor=RGB(0, 0, 0))
swatch_12 = ColourSwatch(SwatchColor=RGB(0, 0, 0))
swatch_13 = ColourSwatch(SwatchColor=RGB(0, 0, 0))
swatch_14 = ColourSwatch(SwatchColor=RGB(0, 0, 0))

cluster_7 = Cluster_2(C=ln_5)
cluster_8 = Cluster_2(C=ln_6)
cluster_9 = Cluster_2(C=ln_8)
cluster_10 = Cluster_2(C=ln_7)

# ----
# BLACK
# ELEMENTS
toggle_3 = GroupToggle(ToggleActive=False, ToggleVisible=True)  # disabled
previewlw_3 = CustomPreviewLineweights(Geometry=cull_3, Shader=shader, Thickness=number_slider_7, Absolute=invert(False))
previewlw_4 = CustomPreviewLineweights(Geometry=cull_4, Shader=shader, Thickness=number_slider_7, Absolute=invert(False))
previewlw_5 = CustomPreviewLineweights(Geometry=cull_5, Shader=shader, Thickness=number_slider_7, Absolute=invert(False))
previewlw_6 = CustomPreviewLineweights(Geometry=cluster_5, Shader=shader, Thickness=Slider(0.03, range=0..1), Absolute=invert(False))

crv_3 = Curve(flatten([cluster_7, cluster_8, cluster_9, cluster_10, cluster_5]))

crv_4 = Curve(crv_3)
eval_2 = EvaluateCurve(Curve=reparameterize(crv_4), Parameter=0.5)  # -> Point, Tangent, Angle
len_2 = Length(Curve=crv_4)
yz_3 = YZPlane(Origin=eval_2.Point)

# ----
# TEXT
toggle_4 = GroupToggle(ToggleActive=False, ToggleVisible=True)  # disabled
tag = TextTag3D(Location=yz_2, Text=area_5.Area, Size=Slider(0.3, range=0..0.5), Colour=col, Justification=5)
tag_2 = TextTag3D(
    Location=yz_3,
    Text=len_2,
    Size=Slider(0.3, range=0..0.5),
    Colour=ColourSwatch(SwatchColor=RGB(102, 0, 8)),
    Justification=7)

# ---- group: joints
end = EndPoints(Curve=flatten([dupln_2, dupln_3, dupln_4, dupln, move_2.Geometry]))  # -> Start, End
end_2 = EndPoints(Curve=flatten([ext, cluster_3, cluster_4, cluster_2, cluster]))  # -> Start, End
ln_9 = Line(StartPoint=end.Start, EndPoint=end_2.Start)
ln_10 = Line(StartPoint=end.End, EndPoint=end_2.End)
join = JoinCurves(Curves=[ln_9, ln_10], Preserve=False)
ext_3 = ExtendCurve(Curve=flatten([ln_9, ln_10]), Type=0, Start=expr("x/2", "1.5"), End=Slider(0, range=0..100))
thicknes = Thicknes(C=ext_3, A="1.5", B="1.5")
brepoffset = OffsetBrep(Brep=thicknes, Distance="0.1", Solid=False, BothSides=False, RoundCorners=True, MergeFaces=False)
previewlw_7 = CustomPreviewLineweights(
    Geometry=brepoffset,
    Shader=ColourSwatch(SwatchColor=RGB(41, 144, 255)),
    Thickness=number_slider_4,
    Absolute=invert(False))

# ----
previewlw_8 = CustomPreviewLineweights(Geometry=cluster_7, Shader=swatch_10, Thickness=Slider(0.21, range=0..1), Absolute=invert(False))
previewlw_9 = CustomPreviewLineweights(Geometry=cluster_8, Shader=swatch_10, Thickness=number_slider_5, Absolute=invert(False))
line_4 = Line(crv_3)
previewlw_10 = CustomPreviewLineweights(Geometry=[cluster_10, cluster_9], Shader=swatch_10, Thickness=number_slider_5, Absolute=invert(False))
lng_9 = ListLength(List=line_4)  # -> expr("x/2", Length)
lng_10 = ListLength(List=crv_3)
jitter_3 = Jitter(List=line_4, Jitter=1, Seed=2)  # -> Values, Indices

# ----
# FIELDS
toggle_5 = GroupToggle(ToggleActive=False, ToggleVisible=True)  # disabled

multiplication_6 = Multiplication(A=lng_10, B=0.95)
split_7 = SplitList(List=jitter_3.Values, Index=lng_9)  # -> ListA, ListB
lng_11 = ListLength(List=split_7.ListB)  # -> expr("x/2", Length)
reduce_4 = RandomReduce(List=crv_3, Reduction=multiplication_6, Seed=1)

# ----
# SOME
# DIAGONALS
toggle_6 = GroupToggle(ToggleActive=False, ToggleVisible=True)  # disabled

dom_7 = ConstructDomain(DomainStart=Slider(0, range=0..1), DomainEnd=Slider(0.3, range=0..1))
lng_12 = ListLength(List=split_7.ListA)
split_8 = SplitList(List=split_7.ListB, Index=lng_11)  # -> ListA, ListB
split_9 = SplitList(List=reduce_4, Index=Slider(50, range=0..100))  # -> ListA, ListB
number_slider_10 = Slider(0.24, range=0..1)
lng_13 = ListLength(List=split_7.ListA)  # -> expr("x/1.2", Length)
random_3 = Random(Range=dom_7, Number=lng_12, Seed=2)
swatch_15 = ColourSwatch(SwatchColor=RGB(0, 0, 0))
swatch_16 = ColourSwatch(SwatchColor=RGB(135, 201, 255))
swatch_17 = ColourSwatch(SwatchColor=RGB(232, 232, 232))
swatch_18 = ColourSwatch(SwatchColor=RGB(255, 166, 173))
split_10 = SplitList(List=split_7.ListA, Index=lng_13)  # -> ListA, ListB
thicknes_2 = Thicknes(C=flatten([cluster_3, cluster_4, move_2.Geometry, cluster, cluster_2]), A="1.5", B="1.5")
thicknes_3 = Thicknes(C=flatten(ext), A="1.5", B="1.5")

previewmat_2 = CustomPreviewMaterials(Geometry=geo_3, DiffuseColor=swatch_17, Transparency=Slider(0.66, range=0..1))
previewmat_3 = CustomPreviewMaterials(Geometry=[geo_2, geo], DiffuseColor=swatch_17, Transparency=Slider(0.88, range=0..1))

previewlw_11 = CustomPreviewLineweights(
    Geometry=split_9.ListA,
    Shader=ColourSwatch(SwatchColor=RGB(201, 0, 17)),
    Thickness=number_slider_10,
    Absolute=invert(False))
previewlw_12 = CustomPreviewLineweights(
    Geometry=split_9.ListB,
    Shader=ColourSwatch(SwatchColor=RGB(0, 86, 214)),
    Thickness=number_slider_10,
    Absolute=invert(False))

# ----
# COLORED
# ELEMENTS
toggle_7 = GroupToggle(ToggleActive=False, ToggleVisible=True)  # disabled
previewlw_13 = CustomPreviewLineweights(
    Geometry=split_10.ListB,
    Shader=ColourSwatch(SwatchColor=RGB(255, 255, 0)),
    Thickness=Slider(0.12, range=0..1),
    Absolute=invert(False))
previewlw_14 = CustomPreviewLineweights(
    Geometry=split_10.ListA,
    Shader=ColourSwatch(SwatchColor=RGB(84, 84, 84)),
    Thickness=Slider(0.1, range=0..0.1),
    Absolute=invert(False))
previewlw_15 = CustomPreviewLineweights(Geometry=split_8.ListA, Shader=ColourSwatch(SwatchColor=RGB(255, 0, 21)), Thickness=random_3, Absolute=invert(False))
previewlw_16 = CustomPreviewLineweights(Geometry=split_8.ListB, Shader=ColourSwatch(SwatchColor=RGB(0, 86, 214)), Thickness=random_3, Absolute=invert(False))

previewlw_17 = CustomPreviewLineweights(
    Geometry=thicknes_2,
    Shader=ColourSwatch(SwatchColor=RGB(196, 102, 102)),
    Thickness=number_slider_4,
    Absolute=invert(False))
previewlw_18 = CustomPreviewLineweights(
    Geometry=thicknes_3,
    Shader=ColourSwatch(SwatchColor=RGB(255, 255, 255)),
    Thickness=number_slider_4,
    Absolute=invert(False))
crv_5 = Curve(flatten([crv_2, ln_7, ln_8, ln_6, ln_5]))

# ---- group: actuators
line_5 = Line(flatten([ln_5, ln_6, ln_8, ln_7]))
lng_14 = ListLength(List=line_5)
multiplication_7 = Multiplication(A=lng_14, B=Slider(0.37, range=0..1))
reduce_5 = RandomReduce(List=line_5, Reduction=multiplication_7, Seed=1)
len_3 = Length(Curve=reduce_5)
subtraction_2 = Subtraction(A=len_3, B=1.5)
division_2 = Division(A=subtraction_2, B=-2)
ext_4 = ExtendCurve(Curve=reduce_5, Type=0, Start=division_2, End=division_2)
swatch_19 = ColourSwatch(SwatchColor=RGB(255, 255, 255))
swatch_20 = ColourSwatch(SwatchColor=RGB(250, 250, 5))
previewlw_19 = CustomPreviewLineweights(
    Geometry=ext_4,
    Shader=ColourSwatch(SwatchColor=RGB(166, 0, 14)),
    Thickness=Slider(0.26, range=0..1),
    Absolute=invert(False))

# ----
eval_3 = EvaluateCurve(Curve=reparameterize(crv_5), Parameter=0.5)  # -> Point, Tangent, Angle
pdecon_3 = Deconstruct(Point=eval_3.Point)  # -> XComponent, YComponent, ZComponent
smaller = SmallerThan(FirstNumber=pdecon_3.ZComponent, SecondNumber=0.1)  # -> SmallerThan, OrEqualTo
cull_6 = CullPattern(List=crv_5, CullPattern=invert(smaller.SmallerThan))  # -> flatten(List)

# ----
# SMOOTH PIPE MESH
toggle_8 = GroupToggle(ToggleActive=True, ToggleVisible=False)  # disabled
crv_6 = Curve(cull_6)

explode_8 = Explode(Curve=crv_6, Recursive=True)  # -> flatten(Segments), Vertices
topo = Topologizer(LinesInput=explode_8.Segments, Tolerance=0.01)  # -> L, P, S, E, N, I, O, G
mp = MultiPipe(
    Curves=topo.L,
    NodeSize=Slider(0.1, range=0.1..3),
    EndOffset=Slider(0.5, range=0..17),
    StrutSize=Slider(0.8, range=0.1..3),
    Segment=Slider(1, range=0.5..10),
    KinkAngle=0.6,
    CubeFit=0)
mpipe = MeshPipe(Curve=ext_4, Radius=Slider(0.2, range=0..1), Accuracy=0.2, Rotation=0, Segments=10, Caps=2)  # disabled
preview_3 = CustomPreview(
    Geometry=mp,
    Material={diffuse=RGB(230, 230, 230), emission=RGB(0, 0, 0), shine=0, specular=RGB(255, 255, 255), transparency=0})

# ==== cluster Cluster
toggle = BooleanToggle(True)
toggle_2 = BooleanToggle(False)
merge = Merge(Data1=toggle, Data2=toggle_2, Data3=toggle_2)
merge_2 = Merge(Data1=toggle_2, Data2=toggle, Data3=toggle_2)
merge_3 = Merge(Data1=toggle_2, Data2=toggle_2, Data3=toggle)
R = ClusterOutput(merge)
R_2 = ClusterOutput(merge_2)
R_3 = ClusterOutput(merge_3)
panel = Panel(merge)

# ==== cluster Cluster_2
number_slider = Slider(-0.4, range=-1..0)
number_slider_2 = Slider(-4, range=-10..-4)
C = ClusterInput()
ext = ExtendCurve(Curve=C, Type=0, Start=number_slider_2, End=number_slider_2)
C_2 = ClusterOutput(ext)

# ==== cluster Thicknes
C = ClusterInput()
A = ClusterInput()
B = ClusterInput()
eval = EvaluateCurve(Curve=reparameterize(C), Parameter=0)  # -> Point, Tangent, Angle
dom = ConstructDomain(DomainStart=expr("x/2", A), DomainEnd=expr("x/-2", B))
pl = PlaneNormal(Origin=eval.Point, ZAxis=eval.Tangent)
rectangle = Rectangle(Plane=pl, XSize=dom, YSize=dom, Radius=0)  # -> Rectangle, Length
extrcrv = ExtrudeAlong(Base=rectangle.Rectangle, Curve=C)
E = ClusterOutput(extrcrv)
